# Grasshopper definition A8-curve.gh (Grasshopper 0.9.80)

number = Number(-5)
number_2 = Number(0)
number_3 = Number(5)

# ---- group: Bottom line
construct_point = ConstructPoint(XCoordinate=number, YCoordinate=0, ZCoordinate=number_2)
construct_point_2 = ConstructPoint(XCoordinate=number, YCoordinate=0, ZCoordinate=number_3)
line = Line(StartPoint=construct_point, EndPoint=construct_point_2)

# ---- group: Outer curve
construct_point_3 = ConstructPoint(XCoordinate=Slider(-25.75, range=-100..100), YCoordinate=0, ZCoordinate=Slider(48.25, range=-100..100))
construct_point_4 = ConstructPoint(XCoordinate=Slider(-29.75, range=-100..100), YCoordinate=0, ZCoordinate=Slider(12.25, range=-100..100))
construct_point_5 = ConstructPoint(XCoordinate=number, YCoordinate=0, ZCoordinate=Slider(50, range=-100..100))
vector_2pt = Vector2Pt(PointA=construct_point, PointB=construct_point_4, Unitize=False)  # -> Vector, Length
vector_2pt_2 = Vector2Pt(PointA=construct_point_5, PointB=construct_point_3, Unitize=False)  # -> Vector, Length
vector_display = VectorDisplay(Anchor=vector_2pt.Vector)
vector_display_2 = VectorDisplay(Anchor=vector_2pt_2.Vector)
bezier_span = BezierSpan(StartPoint=construct_point, StartTangent=vector_2pt.Vector, EndPoint=construct_point_5, EndTangent=vector_2pt_2.Vector)  # -> Curve, Length, Domain

# ---- group: Inner curve
number_slider = Slider(40, range=-100..100)
construct_point_6 = ConstructPoint(XCoordinate=Slider(-21.75, range=-100..100), YCoordinate=0, ZCoordinate=Slider(32.25, range=-100..100))
construct_point_7 = ConstructPoint(XCoordinate=Slider(-19.75, range=-100..100), YCoordinate=0, ZCoordinate=Slider(32.25, range=-100..100))
construct_point_8 = ConstructPoint(XCoordinate=number, YCoordinate=0, ZCoordinate=number_slider)
vector_2pt_3 = Vector2Pt(PointA=construct_point_2, PointB=construct_point_7, Unitize=False)  # -> Vector, Length
vector_2pt_4 = Vector2Pt(PointA=construct_point_8, PointB=construct_point_6, Unitize=False)  # -> Vector, Length
vector_display_3 = VectorDisplay(Anchor=vector_2pt_4.Vector)
vector_display_4 = VectorDisplay(Anchor=vector_2pt_3.Vector)
bezier_span_2 = BezierSpan(
    StartPoint=construct_point_2,
    StartTangent=vector_2pt_3.Vector,
    EndPoint=construct_point_8,
    EndTangent=vector_2pt_4.Vector)  # -> Curve, Length, Domain

# ---- group: Top lines
construct_point_9 = ConstructPoint(XCoordinate=number_2, YCoordinate=0, ZCoordinate=number_slider)
construct_point_10 = ConstructPoint(XCoordinate=number_2, YCoordinate=0, ZCoordinate=construct_point_5)
line_2 = Line(StartPoint=construct_point_8, EndPoint=construct_point_9)
line_3 = Line(StartPoint=construct_point_5, EndPoint=construct_point_10)

# ----
curve = Curve([line_2, line_3, bezier_span_2.Curve, bezier_span.Curve, line])
mirror = Mirror(Geometry=curve, Plane=PlaneYZ(0, 0, 0))  # -> Geometry, Transform
geometry = Geometry([curve, mirror.Geometry])
group = Group(Objects=geometry)
