# Grasshopper definition assignment2.gh (Grasshopper 1.0.7)

# ---- group: Draw square construction piece / Draw square
width = Slider(40, range=0..100)
rectangle = Rectangle(Plane=PlaneXY(0, 0, 0), XSize=width, YSize=width, Radius=0)  # -> Rectangle, Length
multiplication = Multiplication(A=width, B=-0.5)
move_center_to_0_0 = MoveCenterTo00(geometry=rectangle.Rectangle, x_component=multiplication, y_component=multiplication)

# ---- group: Draw square construction piece / Draw slots
slot_width = Slider(2.2, range=0..100)
slot_depth = Slider(10, range=0..100)
number_of_slots = Slider(10, range=0..10)
multiplication_2 = Multiplication(A=slot_depth, B=2)
rectangle_2 = Rectangle(Plane=PlaneXY(0, 0, 0), XSize=slot_width, YSize=multiplication_2, Radius=0)  # -> Rectangle, Length
move_initial_slot_rectangle = MoveInitialSlotRectangle(Y=multiplication, X=slot_width, geometry=rectangle_2.Rectangle)
polar_array = PolarArray(Geometry=move_initial_slot_rectangle, Plane=PlaneXY(0, 0, 0), Count=number_of_slots, Angle=6.283185307)  # -> Geometry, Transform

# ---- group: Draw square construction piece
fillet_curve_radius = Slider(1, range=0..1)
region_difference = RegionDifference(CurvesA=move_center_to_0_0, CurvesB=polar_array.Geometry)
fillet = Fillet(Curve=region_difference, Radius=fillet_curve_radius)

# ---- group: Draw rectangular construction piece
angle = Slider(58, range=0..90)
slot_width_2 = Slider(2.2, range=0..40)
slot_depth_2 = Slider(10, range=0..40)
_40 = Number(40)
_0 = Number(0)
_20 = Number(20)
draw_line = DrawLine(x1_coordinate=_0, y1_coordinate=_0, x2_coordinate=_0, y2_coordinate=_20)  # -> line_2, length_2
draw_line_2 = DrawLine(x1_coordinate=_40, y1_coordinate=_0, x2_coordinate=_40, y2_coordinate=_20)  # -> line_2, length_2
multiplication_3 = Multiplication(A=slot_width_2, B=-0.5)
multiplication_4 = Multiplication(A=draw_line.length_2, B=0.5)
rectangle_3 = Rectangle(Plane=PlaneXY(0, 0, 0), XSize=slot_depth_2, YSize=slot_width_2, Radius=0)  # -> Rectangle, Length
addition = Addition(A=multiplication_3, B=multiplication_4)
subtraction = Subtraction(A=_40, B=slot_depth_2)
position_slot = MoveCenterTo00(geometry=rectangle_3.Rectangle, x_component=subtraction, y_component=addition)
position_slot_2 = MoveCenterTo00(geometry=rectangle_3.Rectangle, x_component=0, y_component=addition)
rotate_right_side = RotateRightSide(degrees=angle, geometry=draw_line_2.line_2)
rotate_right_side_2 = RotateRightSide(degrees=angle, geometry=position_slot)
end_points = EndPoints(Curve=rotate_right_side)  # -> Start, End
end_points_2 = EndPoints(Curve=draw_line.line_2)  # -> Start, End
arc_2pt = Arc2Pt(point_a=end_points_2.End, point_c=end_points.End)
arc_2pt_2 = Arc2Pt(point_a=end_points_2.Start, point_c=end_points.Start)
join_curves = JoinCurves(Curves=[draw_line.line_2, rotate_right_side, arc_2pt_2, arc_2pt], Preserve=False)
region_difference_2 = RegionDifference(curves_a=join_curves, curves_b=rotate_right_side_2, curves_c=position_slot_2)
fillet_2 = Fillet(Curve=region_difference_2, Radius=Slider(1, range=0..1))

# ==== cluster RegionDifference
curves_a = ClusterInput()
curves_b = ClusterInput()
region_difference = RegionDifference(CurvesA=curves_a, CurvesB=curves_b)
curves_c = ClusterInput()
region_difference_2 = RegionDifference(CurvesA=region_difference, CurvesB=curves_c)
result = ClusterOutput(region_difference_2)

# ==== cluster Arc2Pt
point_a = ClusterInput()
point_c = ClusterInput()
construct_point = ConstructPoint(XCoordinate=Slider(10, range=-10..10), YCoordinate=Slider(0, range=0..10), ZCoordinate=0)
average = Average(Input=[point_c, point_a])
addition = Addition(A=construct_point, B=average)
arc_3pt = Arc3Pt(PointA=point_a, PointB=addition, PointC=point_c)  # -> Arc, Plane, Radius
arc = ClusterOutput(arc_3pt.Arc)

# ==== cluster MoveCenterTo00
x_component = ClusterInput()
y_component = ClusterInput()
vector_xyz = VectorXYZ(XComponent=x_component, YComponent=y_component, ZComponent=0)  # -> Vector, Length
geometry = ClusterInput()
move = Move(Geometry=geometry, Motion=vector_xyz.Vector)  # -> Geometry, Transform
geometry_2 = ClusterOutput(move.Geometry)

# ==== cluster MoveInitialSlotRectangle
X = ClusterInput()
Y = ClusterInput()
multiplication = Multiplication(A=Y, B=1.5)
multiplication_2 = Multiplication(A=X, B=-0.5)
vector_xyz = VectorXYZ(XComponent=multiplication_2, YComponent=multiplication, ZComponent=0)  # -> Vector, Length
geometry = ClusterInput()
move = Move(Geometry=geometry, Motion=vector_xyz.Vector)  # -> Geometry, Transform
geometry_2 = ClusterOutput(move.Geometry)

# ==== cluster RotateRightSide
degrees = ClusterInput()
radians = Radians(Degrees=degrees)
multiplication = Multiplication(A=degrees, B=Slider(0.323, range=0..1))
vector_xyz = VectorXYZ(XComponent=multiplication, YComponent=0, ZComponent=0)  # -> Vector, Length
geometry = ClusterInput()
rotate = Rotate(Geometry=geometry, Angle=radians, Plane=PlaneXY(0, 0, 0))  # -> Geometry, Transform
move = Move(Geometry=rotate.Geometry, Motion=vector_xyz.Vector)  # -> Geometry, Transform
geometry_2 = ClusterOutput(move.Geometry)

# ==== cluster DrawLine
x2_coordinate = ClusterInput()
y2_coordinate = ClusterInput()
y1_coordinate = ClusterInput()
x1_coordinate = ClusterInput()
construct_point = ConstructPoint(X1Coordinate=x1_coordinate, Y1Coordinate=y1_coordinate, Z1Coordinate=0)
construct_point_2 = ConstructPoint(X2Coordinate=x2_coordinate, Y2Coordinate=y2_coordinate, Z2Coordinate=0)
line = Line(StartPoint=construct_point, EndPoint=construct_point_2)
length = Length(Curve=line)
line_2 = ClusterOutput(line)
length_2 = ClusterOutput(length)
